# Grasshopper definition HoloFab_Testing.gh (Grasshopper 1.0.7)
# plug-ins: MeshEdit Components, treesloth01, HoloFab

panel = Panel("199.5.80.149")
C = CreateConnection(Address="192.168.1.112", Send=Toggle(False))
number_slider = Slider(426, range=0..1000)  # disabled
number_slider_2 = Slider(483, range=0..1000)  # disabled
number_slider_3 = Slider(-730, range=-1000..1000)  # disabled
number_slider_4 = Slider(0, range=0..1000)  # disabled
number_slider_5 = Slider(0, range=0..1000)  # disabled
number_slider_6 = Slider(0, range=0..1000)  # disabled
number_slider_7 = Slider(519, range=0..1000)  # disabled
number_slider_8 = Slider(0, range=0..1000)  # disabled
xy = XYPlane(Origin=Point(0, 0, 0))  # disabled
xz = XZPlane(Origin=Point(0, 0, 0))  # disabled
ui = UIReceiver(Connect=C)  # -> Toggles, Counters, Sliders; disabled
number_slider_9 = Slider(103, range=0..1000)  # disabled
number_slider_10 = Slider(100, range=0..100)  # disabled
number_slider_11 = Slider(7, range=3..10)  # disabled
number_slider_12 = Slider(3, range=3..10)  # disabled
number_slider_13 = Slider(313, range=0..1000)  # disabled
robot = ValueList({"Choose Robot", "KR150-2_110", "IRB140", "IRB120"}, selected="IRB120")  # disabled
rectangle = Rectangle(Plane=xy, XSize=number_slider, YSize=number_slider, Radius=0)  # -> Rectangle, Length; disabled
robot_2 = ValueList({"Choose Robot", "KR150-2_110", "IRB140", "IRB120"}, selected="IRB140")  # disabled
rectangle_2 = Rectangle(Plane=PlaneXY(0, 0, 0), XSize=number_slider_2, YSize=number_slider_2, Radius=0)  # -> Rectangle, Length; disabled
pt = ConstructPoint(XCoordinate=0, YCoordinate=0, ZCoordinate=number_slider_2)  # disabled
genes = GenePool(Decimals=3, Maximum=3.141, Minimum=0, Value=[0.404, 0.212, 0.768, 0.154, 0, 0])  # disabled
genes_2 = GenePool(Decimals=3, Maximum=3.141, Minimum=0, Value=[3.141, 1.081, 0.554, 0.305, 1.411, 2.407])  # disabled
panel_2 = Panel(ui.Counters)  # disabled
panel_3 = Panel(ui.Toggles)  # disabled
panel_4 = Panel(ui.Sliders)  # disabled
pt_2 = ConstructPoint(XCoordinate=number_slider_3, YCoordinate=number_slider_4, ZCoordinate=number_slider_5)  # disabled
pt_3 = ConstructPoint(XCoordinate=number_slider_6, YCoordinate=number_slider_7, ZCoordinate=number_slider_8)  # disabled
panel_5 = Panel("1")  # disabled
panel_6 = Panel("1")  # disabled
swatch = ColourSwatch(SwatchColor=RGB(66, 72, 252))
swatch_2 = ColourSwatch(SwatchColor=RGBA(55, 0, 255, 135))  # disabled
mplane = MeshPlane(Boundary=rectangle.Rectangle, WidthCount=panel_5, HeightCount=panel_5)  # -> Mesh, Area; disabled
pt_4 = ConstructPoint(XCoordinate=0, YCoordinate=0, ZCoordinate=number_slider_9)  # disabled
msphere = MeshSphere(Base=PlaneXY(0, 0, 0), Radius=number_slider_13, UCount=number_slider_11, VCount=number_slider_11)  # disabled
mplane_2 = MeshPlane(Boundary=rectangle_2.Rectangle, WidthCount=panel_6, HeightCount=panel_6)  # -> Mesh, Area; disabled
msphereex = MeshSphereEx(Base=PlaneXY(0, 0, 0), Radius=number_slider_13, Count=5)  # disabled
msphere_2 = MeshSphere(Base=pt, Radius=number_slider_10, UCount=number_slider_12, VCount=number_slider_12)  # disabled
sph = Sphere(Base=PlaneXY(0, 0, 0), Radius=number_slider_13)  # disabled
panel_7 = Panel("1")  # disabled
panel_8 = Panel("2020")  # disabled
flip = MeshFlip(Mesh=mplane_2.Mesh)  # disabled
hb = HoloBot(Name=robot, ID=0, Plane=pt_2)  # disabled
hb_2 = HoloBot(Name=robot_2, ID=panel_7, Plane=pt_3)  # disabled
stack = StackTrees(Data0=genes, Data1=genes_2, Reduce=True)  # disabled
ht = HoloTag(TextString=panel_8, TextLocation=pt_4, TextSize=20, TextColor=RGB(255, 255, 255), Connect=C)  # disabled
flip_2 = MeshFlip(Mesh=msphere)  # disabled
mesh_streaming_plus = MeshStreamingPlus(Mesh=mplane_2.Mesh, Color=swatch_2, Connect=C)  # disabled
mesh = Mesh(msphere)  # disabled
swatch_3 = ColourSwatch(SwatchColor=RGB(255, 0, 0))  # disabled
demesh = DeconstructMesh(Mesh=mesh)  # -> Vertices, Faces, Colours, Normals; disabled
panel_9 = Panel("0")  # disabled
booleans = Data(ui.Toggles)  # disabled
pi = Pi(Factor=1)  # disabled
sliders = Data(ui.Sliders)  # disabled
item = ListItem(List=booleans, Index=panel_9, Wrap=True)  # disabled
remap = RemapNumbers(Value=sliders, Source=Domain(0, 1), Target=pi)  # -> Mapped, Clipped; disabled
axis_by_branches = Data(stack)  # disabled
mcol = MeshColours(Mesh=mesh, Colours=swatch_3)  # disabled
filter = StreamFilter(Gate=item, Stream0=hb, Stream1=hb_2)  # disabled
demesh_2 = DeconstructMesh(Mesh=mcol)  # -> Vertices, Faces, Colours, Normals; disabled
rc = RobotController(HoloBot=filter, AxisValues=remap.Mapped, Connect=C)  # disabled
rs = RobotStreaming(HoloBotS=[hb_2, hb], Connect=C)  # disabled
rc_2 = RobotController(HoloBot=[hb, hb_2], AxisValues=axis_by_branches, Connect=C)  # disabled
ms = MeshStreaming(Mesh=mcol, Color=swatch_3, Connect=C)  # disabled
